# Grasshopper definition ExampleFile.gh (Grasshopper 1.0.8)
# plug-ins: ParkingDemo

curve = Curve(<curve referenced from the Rhino model>)
curve_2 = Curve(<curve referenced from the Rhino model>)

startgeneration = StartGeneration(AddRampToParking=curve_2, Outline=curve, AddRamp=False, EntranceSide=2, GenerationInterval=1000, WasRunning=True)
boolean_toggle = BooleanToggle(False)
reset_collection = BooleanToggle(True)
block_instance = BlockInstance(<block instance referenced from the Rhino model>)
bake_parking_result = BakeParkingResult(Parking=startgeneration, CarBlock=block_instance)
bake_parking_result_2 = BakeParkingResult(
    Parking=startgeneration,
    CarBlock=block_instance,
    BakeCars=Toggle(True),
    BakeGradientCells=boolean_toggle,
    BakePath=boolean_toggle,
    BakeExcludedCells=boolean_toggle,
    BakeEntranceCell=boolean_toggle,
    BakeWalls=boolean_toggle)
pathfinder = PathFinder(ResetGeneration=reset_collection, Parking=startgeneration)  # -> Parking, GenerationCollection
printresult = PrintResult()
