# Grasshopper definition TestForOutput.gh (Grasshopper 1.0.7)
# plug-ins: ParkingDemo, Heteroptera

crv = Curve(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)
curve = Curve(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)

crv_2 = Curve(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)

crv_3 = Curve(reparameterize(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))
crv_4 = Curve(reparameterize(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))
crv_5 = Curve(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)
crv_6 = Curve(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)
crv_7 = Curve(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)
crv_8 = Curve(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)
crv_9 = Curve(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)
crv_10 = Curve(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)
crv_11 = Curve(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)
crv_12 = Curve(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)
crv_13 = Curve(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)
crv_14 = Curve(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)
crv_15 = Curve(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)
crv_16 = Curve(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)
crv_17 = Curve(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)
crv_18 = Curve(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)
crv_19 = Curve(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)
crv_20 = Curve(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)
crv_21 = Curve(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)
rec = Rectangle({Plane=PlaneXY(-36.17804932, 8.812579263, 0), Size=Domain2(u=-30.67905678..30.67905678, v=-35.06732629..35.06732629)})
crv_22 = Curve(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)
crv_23 = Curve(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)
crv_24 = Curve(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)
crv_25 = Curve(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)
crv_26 = Curve(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)
crv_27 = Curve(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)

regenerate_ramp = Trigger(Interval=-1, TimerInterval=5, Target=[startgeneration, click_to_screen_capture, expression])  # disabled
crv_28 = Curve(crv)
startgeneration = StartGeneration(AddRampToParking=Toggle(True), Outline=crv_28, ExcludeBoundary=curve, EntranceSide=Slider(3, range=0..4))
expression = Expression(Expression="true")
trigger = Trigger(Interval=-1, TimerInterval=5, Target=pathfinder)
pathfinder = PathFinder(ResetGeneration=Toggle(False), Parking=startgeneration)  # -> Parking, GenerationCollection
deconstruct_parking_collection = DeconstructParkingCollection(GenerationCollection=pathfinder.GenerationCollection)  # -> Ids, Scores
sort_list = SortList(Keys=deconstruct_parking_collection.Scores, ValuesValuesA=deconstruct_parking_collection.Ids)  # -> Keys, ValuesValuesA
rampinformation = RampInformation()  # -> RampTypes, RampOrientations
button = Button()
panel = Panel("1")
list_item = ListItem(List=sort_list.ValuesValuesA, Index=Slider(3, range=0..5), Wrap=True)
selectparking = SelectParking(Generations=pathfinder.GenerationCollection, ParkingId=list_item)
deconstrucparking = DeconstrucParking(Parking=selectparking)  # -> Score, PlanMatrix, PathPoints, LotInformations, Cells, SideCellsAddress, PlanOutline, RampInfo
columngridgenerator = ColumnGridGenerator(Parking=pathfinder.Parking)  # -> H, V, Parking
pathpts = Data(flatten(deconstrucparking.PathPoints))
# column grid
cluster = Cluster_8(
    x_coordinate=columngridgenerator.V,
    y_coordinate=columngridgenerator.H,
    curve=deconstrucparking.PlanOutline,
    Panel=columngridgenerator.V)  # -> surface_2, colour_swatch
# print result and display cells
cluster_2 = Cluster_7(geometry=deconstrucparking.PlanOutline, curve=deconstrucparking.PlanOutline)  # -> curve_2, brep, colour_swatch
# path display
cluster_3 = Cluster_5(relay=deconstrucparking.PathPoints)  # -> geometry, colour_swatch
# cells address
cluster_4 = Cluster_4(data_3=deconstrucparking.Cells, data=deconstrucparking.Cells, matrix=deconstrucparking.PlanMatrix)  # -> D, geometry, paths, panel_3, colour_swatch
# ramp display
generalrampinformation = GeneralRampInformation()  # -> RampTypes, RampOrientations
# parking lots display
cluster_5 = Cluster(T_2=deconstrucparking.LotInformations, T=deconstrucparking.LotInformations)  # -> data_4, swatch_2, data_3, swatch
click_to_screen_capture = Button()
cluster_6 = Cluster_3(
    L=deconstrucparking.RampInfo,
    L_2=generalrampinformation.RampOrientations,
    T=deconstrucparking.SideCellsAddress,
    T_2=generalrampinformation.RampTypes)  # -> G_2, swatch, C, G
file_path = FilePath("G:\archtech\thesis\FatemeThesis\Visualization\imcap\sample parkings\parking01\")

# ----
# Export jpeg
panel_2 = Panel("Parking03")
printresult = PrintResult(
    SaveFolderPath=file_path,
    OutlineBoundingRectangle=cluster_2.curve_2,
    ParkingName=panel_2,
    ResetPreviewSheet=click_to_screen_capture)

preview = CustomPreview(Geometry=cluster_6.G_2, Material=cluster_6.C)
preview_2 = CustomPreview(Geometry=cluster_6.G, Material=cluster_6.swatch)
preview_3 = CustomPreview(Geometry=cluster_5.data_4, Material=cluster_5.swatch_2)
preview_4 = CustomPreview(Geometry=cluster_5.data_3, Material=cluster_5.swatch)
custom_preview = CustomPreview(Geometry=cluster_3.geometry, Material=cluster_3.colour_swatch)
custom_preview_2 = CustomPreview(Geometry=cluster_4.D, Material=cluster_4.colour_swatch)
text_tag_3d = TextTag3D(
    Location=cluster_4.geometry,
    Text=graft(cluster_4.paths),
    Size=cluster_4.panel_3,
    Colour=cluster_4.colour_swatch,
    Justification=5)
custom_preview_3 = CustomPreview(Geometry=cluster_2.brep, Material=cluster_2.colour_swatch)
custom_preview_4 = CustomPreview(Geometry=cluster.surface_2, Material=cluster.colour_swatch)
number_slider = Slider(0.2, range=0..1)

# ----
# path display
point_in_curve = PointInCurve(Point=pathpts, Curve=deconstrucparking.PlanOutline)  # -> Relationship, Point
equality = Equality(FirstNumber=point_in_curve.Relationship, SecondNumber="2")  # -> Equality, Inequality
dispatch = Dispatch(List=pathpts, DispatchPattern=equality.Equality)  # -> ListA, ListB
mst = MST(BasePoints=dispatch.ListA)  # -> PointPointTopology, ConnectionPointTopology, Lines

number_slider_2 = Slider(0.3, range=0..1)
join_curves = JoinCurves(Curves=mst.Lines, Preserve=False)
offset_curve = OffsetCurve(Curve=join_curves, Distance=expr("-x", number_slider_2), Corners=1)
offset_curve_2 = OffsetCurve(Curve=join_curves, Distance=number_slider_2, Corners=1)
end_points = EndPoints(Curve=offset_curve_2)  # -> Start, End
end_points_2 = EndPoints(Curve=offset_curve)  # -> Start, End
line = Line(StartPoint=end_points.Start, EndPoint=end_points_2.Start)
line_2 = Line(StartPoint=end_points.End, EndPoint=end_points_2.End)
join_curves_2 = JoinCurves(Curves=[offset_curve_2, offset_curve, line, line_2], Preserve=False)
region_union = RegionUnion(Curves=flatten(join_curves_2))
fillet_distance = FilletDistance(Curve=region_union, Distance=Slider(0.2, range=0..1))
surface = Surface(fillet_distance)

panel_3 = Panel("""1.5
1""")
number_slider_3 = Slider(0.1, range=0..0.1)
dash_pattern = DashPattern(Curve=join_curves, Pattern=panel_3)  # -> Dashes, Gaps
panel_4 = Panel(".04")
offset_curve_3 = OffsetCurve(Curve=dash_pattern.Dashes, Distance=expr("-x", number_slider), Corners=1)
offset_curve_4 = OffsetCurve(Curve=dash_pattern.Dashes, Distance=number_slider, Corners=1)
end_points_3 = EndPoints(Curve=offset_curve_4)  # -> Start, End
end_points_4 = EndPoints(Curve=offset_curve_3)  # -> Start, End
line_3 = Line(StartPoint=end_points_3.Start, EndPoint=end_points_4.Start)
line_4 = Line(StartPoint=end_points_3.End, EndPoint=end_points_4.End)
join_curves_3 = JoinCurves(Curves=[line_3, line_4, offset_curve_4, offset_curve_3], Preserve=False)
panel_5 = Panel("11,11,45")
surface_2 = Surface(join_curves_3)

list_length = ListLength(List=flatten(surface))

custom_preview_5 = CustomPreview(Geometry=surface, Material="229,229,26")
custom_preview_6 = CustomPreview(Geometry=surface_2, Material="229,229,26")

expression_2 = Expression(x=list_length, Expression="x≠0")

# ==== cluster Cluster
T = ClusterInput()
T_2 = ClusterInput()

# ----
# parking lots display
crv = Curve([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])
surface = Surface([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])
rotate = Rotate(Geometry=crv, Angle=degrees("180"), Plane=PlaneXY(0, 0, 0))  # -> Geometry, Transform
rotate_2 = Rotate(Geometry=surface, Angle=degrees("180"), Plane=PlaneXY(0, 0, 0))  # -> Geometry, Transform
crv_2 = Curve(rotate_2.Geometry)
transform = Transform(Geometry=rotate.Geometry, Transform=T)
transform_2 = Transform(Geometry=rotate_2.Geometry, Transform=T_2)
data = Data(transform)
data_2 = Data(transform_2)

data_3 = ClusterOutput(data)
data_4 = ClusterOutput(data_2)
swatch = ClusterOutput(ColourSwatch(SwatchColor=RGB(9, 10, 9)))
swatch_2 = ClusterOutput(ColourSwatch(SwatchColor=RGB(200, 224, 202)))

# ==== cluster Cluster_3
T = ClusterInput()
L = ClusterInput()
T_2 = ClusterInput()
L_2 = ClusterInput()

# ----
# ramp info:
# 0: side
# 1: cell index on its side
# 2: ramp type
# 3: orientation
item = ListItem(List=L, Index=0, Wrap=True)  # -> Item, Item1, Item2, Item3

branch = TreeBranch(Tree=T, Path=item.Item, MaintainPaths=True)
branch_2 = TreeBranch(Tree=T_2, Path=item.Item2, MaintainPaths=True)
number_slider = Slider(5, range=0..10)
item_2 = ListItem(List=branch, Index=item.Item1, Wrap=True)
multiplication = Multiplication(A=branch_2, B=5)
addition = Addition(A=multiplication, B=item_2, C="{-2.5,-2.5,0}")
rectangle = Rectangle(Plane=addition, XSize=number_slider, YSize=number_slider, Radius=0)  # -> Rectangle, Length
item_3 = ListItem(List=rectangle.Rectangle, Index=0, Wrap=True)
boundary = BoundarySurfaces(Edges=rectangle.Rectangle)
lng = ListLength(List=rectangle.Rectangle)
area = Area(Geometry=item_3)  # -> Area, Centroid
cluster = Cluster_2(i=item.Item2, T="{-2.5,-2.5,0}")
range = Range(Domain="0 to 0.8", Steps=expr("x-1", lng))  # -> reverse(Range)
item_4 = ListItem(List=L_2, Index=item.Item3, Wrap=True)
move = Move(Geometry=boundary, Motion=expr("-x", area.Centroid))  # -> Geometry, Transform
gradient = Gradient(LowerLimit=0, UpperLimit=1, Parameter=range, stops=[0: RGB(192, 0, 0), 0: RGB(255, 255, 255), 1: RGB(128, 128, 128)])
transform = Transform(Geometry=move.Geometry, Transform=item_4)
move_2 = Move(Geometry=transform, Motion=area.Centroid)  # -> Geometry, Transform
transform_2 = Transform(Geometry=cluster, Transform=item_4)
move_3 = Move(Geometry=transform_2, Motion=area.Centroid)  # -> Geometry, Transform
G = ClusterOutput(move_3.Geometry)
G_2 = ClusterOutput(move_2.Geometry)
C = ClusterOutput(gradient)
swatch = ClusterOutput(ColourSwatch(SwatchColor=RGB(186, 168, 168)))

# ==== cluster Cluster_4
data = ClusterInput()
data_2 = Data(data)
matrix = ClusterInput()
data_3 = ClusterInput()

deconstruct_matrix = DeconstructMatrix(Matrix=matrix)  # -> Rows, Columns, Values
plasticanchor = PlasticAnchor(Limit=1, Strength=1, Reset=False)
data_4 = Data(data_3)
partition_list = PartitionList(List=deconstruct_matrix.Values, Size=deconstruct_matrix.Columns)
area = Area(Geometry=data_4)  # -> Area, Centroid
partition_list_2 = PartitionList(List=partition_list, Size="1")  # -> simplify(Chunks)

# ---- group: to remove 0 items in matrix
equality = Equality(FirstNumber=partition_list_2, SecondNumber=0)  # -> Equality, Inequality
tree_statistics = TreeStatistics(Tree=partition_list_2)  # -> Paths, Length, Count
dispatch = Dispatch(List=tree_statistics.Paths, DispatchPattern=flatten(equality.Inequality))  # -> ListA, ListB
tree_branch = TreeBranch(Tree=partition_list_2, Path=dispatch.ListA, MaintainPaths=True)

# ----
tree_statistics_2 = TreeStatistics(Tree=area.Centroid)  # -> Paths, Length, Count
tree_branch_2 = TreeBranch(Tree=partition_list_2, Path=tree_statistics_2.Paths, MaintainPaths=True)
move = Move(Geometry=area.Centroid, Motion="-1.7,-1.7,0")  # -> Geometry, Transform
tree_statistics_3 = TreeStatistics(Tree=tree_branch_2)  # -> Paths, Length, Count
panel = Panel("1")

panel_2 = Panel("""0.3
0.5
0.2""")
dash = DashPattern(Curve=data_2, Pattern=panel_2)  # -> Dashes, Gaps
colour_swatch = ClusterOutput(ColourSwatch(SwatchColor=RGB(0, 0, 0)))
D = ClusterOutput(dash.Dashes)
panel_3 = ClusterOutput("0.5")
geometry = ClusterOutput(move.Geometry)
paths = ClusterOutput(tree_statistics_3.Paths)

# ==== cluster Cluster_5
relay = ClusterInput()

curve = Curve(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)
data = Data(relay)
area = Area(Geometry=curve)  # -> Area, Centroid
subtraction = Subtraction(A=data, B=area.Centroid)
surface = Surface(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)
graft_tree = GraftTree(Tree=subtraction, IncludeEmptyLists=True, IncludeNullItems=True)
move = Move(Geometry=surface, Motion=graft_tree)  # -> flatten(Geometry), Transform

geometry = ClusterOutput(move.Geometry)
colour_swatch = ClusterOutput(ColourSwatch(SwatchColor=RGB(160, 181, 136)))

# ==== cluster Cluster_7
geometry = ClusterInput()
curve = ClusterInput()

# ----
# preview outline
cluster = Cluster_6(curve=curve)

brep = ClusterOutput(cluster)

# ---- group: save preview results
bounding_rectangle = BoundingRectangle(Geometry=geometry, Plane=PlaneXY(0, 0, 0), Axis=0, Slide=0, Union=True)  # -> Bounding, DimensionX, DimensionY
rectangle = Rectangle(bounding_rectangle.Bounding)
boolean_toggle = BooleanToggle(True)
offset_curve = OffsetCurve(Curve=rectangle, Distance="3", Corners=1)

# ----
colour_swatch = ClusterOutput(ColourSwatch(SwatchColor=RGB(0, 0, 0)))
curve_2 = ClusterOutput(offset_curve)

# ==== cluster Cluster_8
x_coordinate = ClusterInput()
y_coordinate = ClusterInput()
construct_point = ConstructPoint(XCoordinate=graft(x_coordinate), YCoordinate=y_coordinate, ZCoordinate=0)
curve = ClusterInput()
panel = Panel(ClusterInput())
point_in_curve = PointInCurve(Point=construct_point, Curve=curve)  # -> Relationship, Point
equality = Equality(FirstNumber=point_in_curve.Relationship, SecondNumber="0")  # -> Equality, Inequality
dispatch = Dispatch(List=construct_point, DispatchPattern=equality.Inequality)  # -> ListA, ListB
data = Data(dispatch.ListA)

division = Division(A="0.5", B=-2)
unit_x = UnitX(Factor=division)
unit_y = UnitY(Factor=division)
addition = Addition(A=unit_x, B=unit_y)
move = Move(Geometry=data, Motion=addition)  # -> Geometry, Transform

circle = Circle(Plane=data, Radius=".3")
rectangle = Rectangle(Plane=move.Geometry, XSize="0.5", YSize="0.5", Radius=0)  # -> Rectangle, Length
# display columns
surface = Surface(circle)
colour_swatch = ClusterOutput(ColourSwatch(SwatchColor=RGB(0, 15, 51)))
surface_2 = ClusterOutput(surface)

# ==== cluster Cluster_2
i = ClusterInput()
T = ClusterInput()

geo = Geometry([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])
join = JoinCurves(Curves=geo, Preserve=False)
geo_2 = Geometry([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])
geo_3 = Geometry([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])
geo_4 = Geometry([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])
geo_5 = Geometry([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])
geo_6 = Geometry([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])
group = Group(Objects=geo)
group_2 = Group(Objects=geo_4)
group_3 = Group(Objects=geo_3)
group_4 = Group(Objects=geo_6)
group_5 = Group(Objects=geo_5)
group_6 = Group(Objects=geo_2)
merge = Merge(Data1=group, Data2=group_2, Data3=group_3, Data4=group_4, Data5=group_5, Data6=group_6)
item = ListItem(List=merge, Index=i, Wrap=True)
scale = Scale(Geometry=item, Center=Point(0, 0, 0), Factor="5")  # -> Geometry, Transform
move = Move(Geometry=scale.Geometry, Motion=T)  # -> Geometry, Transform
rotate = Rotate(Geometry=move.Geometry, Angle="pi/2", Plane=PlaneXY(0, 0, 0))  # -> Geometry, Transform

G = ClusterOutput(rotate.Geometry)

# ==== cluster Cluster_6
curve = ClusterInput()
data = ClusterInput()
simplify_curve = SimplifyCurve(Curve=curve)  # -> Curve, Simplified
data_2 = Data(data)
offset_curve = OffsetCurve(Curve=simplify_curve.Curve, Distance=".3", Corners=1)
end_points = EndPoints(Curve=simplify_curve.Curve)  # -> Start, End
end_points_2 = EndPoints(Curve=offset_curve)  # -> Start, End
line = Line(StartPoint=end_points_2.Start, EndPoint=end_points.Start)
sweep2 = Sweep2(Rail1=simplify_curve.Curve, Rail2=offset_curve, Sections=line, SameHeight=False)
brep = ClusterOutput(sweep2)
